% Simulink data dictionary BlindSpotDataTypes.sldd

BlindSpotDetectedType = Simulink.AliasType(BaseType="boolean", HeaderFile="Rte_Type.h")
BlindSpotWarningType = Simulink.AliasType(BaseType="boolean", HeaderFile="Rte_Type.h")

TurnSignalStatusType = enum(HeaderFile="Rte_Type.h", DefaultValue="NONE")
  NONE = 0
  LEFT = 1
  RIGHT = 2